# Grasshopper definition 00_calculator_hs24.gh (Grasshopper 1.0.7)

# ----
# Ungraded assignment: Mini Calculator
# Simple “Mini Calculator”
number_slider = Slider(0, range=0..10)
# Main Task
# The task is to create a simple calculator program that can perform four basic arithmetic operations: addition, subtraction, multiplication, and division. The calculator could also handle division by zero and invalid operations.
# 
# The calculator should accept two input numbers and an arithmetic operation from a Grasshopper value list input component. ("addition", "subtraction", "multiplication", "division") Based on the selected operation it should perform the correct arithmetic calculation.
# 
# Optionally, introduce an error handling in case a number is divided by zero or if the operation name is invalid.
# Challenge 01
# Create more user-friendly messages, that not only display the result but also explain the operation being performed.
# Create a custom print statement for each operation.
# Example: addition: "The result of [num_01] + [num_02] is: [result]"
# Challenge 02
# Increase the readability of the code. Use a set of functions for each operation and one function for the main calculator
list = ValueList({"addition", "subtraction", "multiplication", "division"}, selected="division")
python = GhPythonScript(x=number_slider, y=Slider(0, range=0..10), method=list)  # -> out, result
# ---------- python: Python ----------
def calculator(x, y, method):
    """
    Note that this function is executed in python 2.7.
    the main function of calculator, which calls other calculation functions
    depending on the method.

    :param x: the first number
    :type x: float
    :param y: the second number
    :type y: float
    :param method: a string that specifies the calculation method
    :type method: str
    :raises ValueError: if the method is not one of the four valid methods
    :return: Invalid method
    :rtype: float
    """
    if method == "addition":
        return add(x, y)
    elif method == "subtraction":
        return subtract(x, y)
    elif method == "multiplication":
        return multiply(x, y)
    elif method == "division":
        return divide(x, y)
    else:
        raise ValueError("Invalid method")


def add(x, y):
    result = x + y
    print("the result from adding {} and {} is {}.".format(x, y, result))
    return result


def subtract(x, y):
    result = x - y
    print("the result from subtracting {} and {} is {}.".format(x, y, result))
    return result


def multiply(x, y):
    result = x * y
    print("the result from multiplying {} and {} is {}.".format(x, y, result))
    return result


def divide(x, y):
    if y == 0:
        if x != 0:
            raise ValueError("Cannot divide by zero!")
        else: # x and y are both 0, by definition the division result should be 1.
            result = 1
    else:           
        result = x / y
    print("the result from dividing {} and {} is {}.".format(x, y, result))
    return result


if __name__ == "__main__":
    if type(x) == int:
        x = float(x)
    elif type(x) == float:
        pass
    else:
        raise ValueError("x must be either int or float!")

    if type(y) == int:
        y = float(y)
    elif type(y) == float:
        pass
    else:
        raise ValueError("y must be either int or float!")

    result = calculator(x, y, method)
# ---------- end python ----------
panel = Panel(python.result)
panel_2 = Panel(python.out)
