# Grasshopper definition A01-Brick-Wall_HS24.gh (Grasshopper 1.0.7)

mortar_thickness = Slider(0.1, range=0.01..2)
# Remember the
# type hints
num = Number(mortar_thickness)

# ----
# Optional
rotation_factor = Slider(-4.73, range=-10..10)
attractor_point = Point(Point(19.25461374, 26.19431981, 4.271373125))

mortar_thickness_2 = Slider(0.15, range=0.01..2)
num_2 = Number(mortar_thickness_2)
# Remember the
# type hints
num_3 = Number(rotation_factor)

# ----
# Optional
rotation_factor_2 = Slider(0, range=-10..10)
attractor_point_2 = Point(Point(14.25107049, 23.14355013, 0.1231497297))

mortar_thickness_3 = Slider(0.15, range=0.01..2)
# Remember the
# type hints
num_4 = Number(mortar_thickness_3)

# ----
# Challenge 02:
brick_x_dimension = Slider(2, range=0.01..2)
brick_y_dimension = Slider(1, range=0.01..2)
number_of_rows = Slider(13, range=1..20)
brick_z_dimension = Slider(0.6, range=0.01..2)
number_of_columns = Slider(12, range=1..20)
brickwall = GhPythonScript(
    xsize=brick_x_dimension,
    ysize=brick_y_dimension,
    zsize=brick_z_dimension,
    row_count=number_of_rows,
    column_count=number_of_columns,
    d_mortar=num_4,
    rotation_factor=rotation_factor_2,
    attractor_point=attractor_point_2)  # -> brick_wall; inputs row_count: Int32, column_count: Int32, attractor_point: Point3d
# ---------- brickwall: Python ----------
"""
## Challenge 02

Improve the previous script (either with or without challenge 01) by introducing
half-bricks at the start and end of every other row. This will create a more
realistic and structurally sound brick pattern, similar to how bricks are laid
in typical stretcher bond.

### Details

- Modify your script to include half-bricks at the start or end of every other row.
- Find a way to differentiate between every other row of bricks to facilitate your placement logic of the half-bricks.
- Ensure the half-bricks are correctly proportioned, such that the wall ends are flush.
- Ensure the half-bricks are correctly positioned and aligned with the full bricks, taking into account the staggered pattern.

"""

# 0. Import everything we will need
import math
from compas.geometry import Box, Point, Frame, Vector
from compas_rhino.conversions import point_to_compas

def build_box(x, y, z, lx, ly, lz, rangle=None, raxis=None, rpoint=None):
    """
    x, y, z are floats defining the central point of the plane that defines the box;
    lx, ly, lz are floats defining the length, width and height of the box;
    rangle is float that defines the rotation of the box in radians. 
        By default, it chooses the world XY and world origin point 
        as rotation axis and origin point.
    """
    point = Point(x, y, z)
    frame = Frame(point)
    box = Box(lx, ly, lz, frame)
    if rpoint==None:
        rpoint = point
        
    if rangle != None:
        box.rotate(angle=rangle, axis=raxis, point=rpoint)
    return box

# 1. Start with an empty list of bricks to be created
#    make sure to match the name of this list to the output of this component!
# [ADD YOUR CODE HERE...]
brick_wall = []

ref_point = point_to_compas(attractor_point)

# 2. Create two for loops, one nested inside the other,
#    to iterate over the range of row_count and column_count
for nrow in range(row_count):
    # by introducing half brick, we have one more column
    for ncol in range(column_count+1):
        py = 0
        pz = nrow * zsize + (nrow-1) * d_mortar
        lx = xsize
        ly = ysize
        lz = zsize
        # 3. If the row is odd, the first would be half brick
        if nrow % 2 == 1:
            ncol = ncol-1/2
            px = ncol * (xsize + d_mortar)
            if ncol == -0.5:
                # create half brick at the beginning
                px = -xsize/4
                lx = xsize/2

        else:
            px = ncol * (xsize + d_mortar)
            if ncol == column_count:
                # create half brick at the end
                lx = xsize/2
                px = ncol * (xsize + d_mortar) - 1/2*(lx + d_mortar)

        # 4. Define the variables x, y, z based on the current column, row
        #    and the inputs for sizes, mortar gaps and offset

        # 5. Assign a boolean variable is_halfbrick 
        #    based on conditionally checking the criteria for half bricks

        # 6. Create a new box taking into account that half-bricks need to be half the X size

        # 7. If it's a half brick...
        # [ADD YOUR CODE HERE...]
            # 8. Move the x coordinate left or right depending on weather it's first or last
            # [ADD YOUR CODE HERE...]

        # 9. Move brick to the correct location
        # [ADD YOUR CODE HERE...]
        
        # 10. Rotate brick based on some logic
        #     For example, calculate the distance from the center point of the brick (x, y, z)
        #     to a reference point (either hard-coded here or referenced adding an input parameter)
        #     Hint: the formula for distance requires using square root, in python `math.sqrt`
        #           and it is as follows:
        #           math.sqrt((x2 - x1)**2 + (y2 - y1)**2 + (z2 - z1)**2)
        attracted_vector = Vector(ref_point.x-px, ref_point.y-py, 0)
        y_vector = Vector(0, 1, 0)
        angle = y_vector.angle(attracted_vector)
        axis = y_vector.cross(attracted_vector)
        brick = build_box(px, py, pz, lx, ly, lz, angle, axis)
        # 11. Append the brick to the output list
        brick_wall.append(brick)
# ---------- end brickwall ----------

# ----
# Preview
draw = Draw(cg=brickwall)  # -> rg
#   port cg: The COMPAS geometry or datastructure to be drawn.
# ---------- draw: Python ----------
from compas.geometry import Point, Box
from compas_rhino.conversions import point_to_rhino, box_to_rhino

rg = None
if cg:
    if isinstance(cg, Point):
        rg = point_to_rhino(cg)
    elif isinstance(cg, Box):
        rg = box_to_rhino(cg)
# ---------- end draw ----------
preview = CustomPreview(
    Geometry=draw,
    Material={diffuse=RGB(197, 130, 64), emission=RGB(68, 53, 68), shine=0.5, specular=RGB(255, 254, 254), transparency=0})

# ---- group: 2. Set file name
# Challenge 02
# Challenge 02
# Double click button
# Challenge 02: ## Challenge 02
# 
# Improve the previous script (either with or without challenge 01) by introducing
# half-bricks at the start and end of every other row. This will create a more
# realistic and structurally sound brick pattern, similar to how bricks are laid
# in typical stretcher bond.
# 
# ### Details
# 
# - Modify your script to include half-bricks at the start or end of every other row.
# - Find a way to differentiate between every other row of bricks to facilitate your placement logic of the half-bricks.
# - Ensure the half-bricks are correctly proportioned, such that the wall ends are flush.
# - Ensure the half-bricks are correctly positioned and aligned with the full bricks, taking into account the staggered pattern.
mustermann_max = Panel("Yiqiao_Wang")
assignment_nr = Panel("A01_02")

# ---- group: 4. Set display options
toggle = BooleanToggle(False)
toggle_2 = BooleanToggle(False)

# ---- group: 5. Click button to save image
button = Button()

# ---- group: 3. Set image dimensions
width = Panel("3200")
height = Panel("2400")

# ---- group: 1. Select target directory
# Generate a .png image of your current Rhino viewport
path = FilePath("C:\Users\wangy\OneDrive\桌面\")

# ----
python = GhPythonScript(
    path=path,
    name=mustermann_max,
    assignment_nr=assignment_nr,
    width=width,
    height=height,
    display_grid=toggle,
    display_grid_axes=toggle_2,
    save=button)  # -> out; inputs width: Int32, height: Int32
# ---------- python: Python ----------
import Rhino.Display as rd
import scriptcontext as sc
import System
import os

file_name = name + "_" + assignment_nr

def get_next_index(path):
    index = 1
    while os.path.exists(path + file_name + str(index) + ".png"):
        index += 1
    return index

def ViewCaptureToFile(path):
    view = sc.doc.Views.ActiveView
    if view:
        view_capture = rd.ViewCapture()
        view_capture.TransparentBackground = False
        view_capture.Width = view.ActiveViewport.Size.Width
        view_capture.Height = view.ActiveViewport.Size.Width
        view_capture.ScaleScreenItems = False
        view_capture.DrawAxes = True
        view_capture.DrawGrid = display_grid
        view_capture.DrawGridAxes = display_grid_axes
        size = System.Drawing.Size(view_capture.Width, view_capture.Height)
        size = System.Drawing.Size(width, height)
        
        settings = rd.ViewCaptureSettings(view, size, 72) # view, size, dpi
        settings.RasterMode = True
        settings.DrawGrid = display_grid
        settings.DrawAxis = display_grid_axes
        settings.DrawWallpaper = False
        index = get_next_index(path)
            
        filename = file_name + str(index)
        filename_with_extension = filename + ".png"
        bitmap = rd.ViewCapture.CaptureToBitmap(settings)
        fullpath = path + filename_with_extension
        bitmap.Save(fullpath)
        
        return filename_with_extension
        
        
if path is None:
    ghenv.Component.Message = "Please select a target directory first"
else:
    if save:
        path = ViewCaptureToFile(path)
        ghenv.Component.Message = "Saved image to " + path
# ---------- end python ----------

brick_x_dimension_2 = Slider(2, range=0.01..2)
brick_y_dimension_2 = Slider(1, range=0.01..2)
brick_z_dimension_2 = Slider(0.6, range=0.01..2)
number_of_rows_2 = Slider(13, range=1..20)
number_of_columns_2 = Slider(9, range=1..20)

# ----
# Assignment 01
# Main Task:
num_5 = Number(brick_x_dimension_2)
num_6 = Number(brick_y_dimension_2)
num_7 = Number(brick_z_dimension_2)
int = Integer(number_of_rows_2)
int_2 = Integer(number_of_columns_2)

# ----
# Main Task
# Main Task
# Double click button
# Main Task: ### Main Task
# 
# - Create a virtual brick wall using Python and the COMPAS framework.
# - Your brick dimensions as well as wall height and length should react parametrically to
# the provided input sliders.
# - Implement the wall such that every other row is offset by half the brick's length to mimic
# a strecher bond pattern.
# 
# ### Details
# 
# - Create a Python script that generates a 3D representation of a brick wall.
# - Each brick should be represented as an instance of the `Box` class from the COMPAS geometry
# module.
# - Create a fully parametric brick wall by making use of the provided number sliders:
#   - Use the input sliders for the brick dimensions (`xsize`, `ysize` and `zsize`).
#   - Use the input sliders for the number of rows and columns(`row_count` and `column_count`) to
#   control the number of bricks in both directions.
# - Ensure that the data type of the input sliders matches those specified on the prepared
# number sliders. (Right-click each of the inputs and navigate to **Type hint**.)
# 
# ### Bonus Tasks
# 
# - Introduce a mortar gap (Moertelfuge) between the bricks of a fixed size across all bricks.
#   Ensure that the gap size is consistent across all bricks.
# 
# ### Functions, Classes, Methods, and Statements You Will Need
# 
# - Geometric types (`Box`, `Point` from COMPAS).
# - Loop statements (for loops for generating rows and columns).
# - Conditional statements (for applying row offset).
brickwall_2 = GhPythonScript(xsize=num_5, ysize=num_6, zsize=num_7, row_count=int, column_count=int_2, d_mortar=num)  # -> brick_wall
# ---------- brickwall_2: Python ----------
"""
### Main Task

- Create a virtual brick wall using Python and the COMPAS framework. 
- Your brick dimensions as well as wall height and length should react parametrically to 
the provided input sliders.
- Implement the wall such that every other row is offset by half the brick's length to mimic 
a strecher bond pattern.

### Details

- Create a Python script that generates a 3D representation of a brick wall.
- Each brick should be represented as an instance of the `Box` class from the COMPAS geometry 
module.
- Create a fully parametric brick wall by making use of the provided number sliders:
  - Use the input sliders for the brick dimensions (`xsize`, `ysize` and `zsize`).
  - Use the input sliders for the number of rows and columns(`row_count` and `column_count`) to 
  control the number of bricks in both directions.
- Ensure that the data type of the input sliders matches those specified on the prepared 
number sliders. (Right-click each of the inputs and navigate to **Type hint**.)

### Bonus Tasks

- Introduce a mortar gap (Moertelfuge) between the bricks of a fixed size across all bricks. 
  Ensure that the gap size is consistent across all bricks.

### Functions, Classes, Methods, and Statements You Will Need

- Geometric types (`Box`, `Point` from COMPAS).
- Loop statements (for loops for generating rows and columns).
- Conditional statements (for applying row offset).

"""

# 0. Import everything we will need
from compas.geometry import Box, Point, Frame

def build_box(x, y, z, lx, ly, lz, rangle=None, raxis=None, rpoint=None):
    """
    x, y, z are floats defining the central point of the plane that defines the box;
    lx, ly, lz are floats defining the length, width and height of the box;
    rangle is float that defines the rotation of the box in radians. 
        By default, it chooses the world XY and world origin point 
        as rotation axis and origin point.
    """
    point = Point(x, y, z)
    frame = Frame(point)
    box = Box(lx, ly, lz, frame)
    if rpoint==None:
        rpoint = point
        
    if rangle != None:
        box.rotate(angle=rangle, axis=raxis, point=rpoint)
    return box

# 1. Start with an empty list of bricks to be created
#    make sure to match the name of this list to the output of this component!
# [ADD YOUR CODE HERE...]
brick_wall = []

# 2. Create two for loops, one nested inside the other,
#    to iterate over the range of row_count and column_count
for nrow in range(row_count):
    for ncol in range(column_count):

        # 3. If the row is odd, calculate an offset of half the size in X
        if nrow % 2 == 1:
            ncol = ncol+1/2

        # 4. Define the variables x, y, z based on the current column, row
        #    and the inputs for sizes, mortar gaps and offset
        # [ADD YOUR CODE HERE...]
        # assumes that this brick wall spans along the x-z plane
        # this means that y of the origin point is always 0
        
        px = ncol * (xsize + d_mortar)
        py = 0
        pz = nrow * zsize + (nrow-1) * d_mortar
        # 5. Create a new box
        # [ADD YOUR CODE HERE...]
#        p_ori = Point(x=px, y=py, z=pz)
#        b_frame = Frame(p_ori)
#        brick = Box(xsize=xsize, ysize=ysize, zsize=zsize, frame=b_frame)
        brick = build_box(px, py, pz, xsize, ysize, zsize)
        # 6. Move brick to the correct location
        # [ADD YOUR CODE HERE...]
        
        # 7. Append the brick to the output list
        brick_wall.append(brick)
# ---------- end brickwall_2 ----------

# ----
# Preview
draw_2 = Draw(cg=brickwall_2)  # -> rg; same code as draw
preview_2 = CustomPreview(
    Geometry=draw_2,
    Material={diffuse=RGB(197, 130, 64), emission=RGB(68, 53, 68), shine=0.5, specular=RGB(255, 254, 254), transparency=0})

# ----
# Challenge 01:
brick_x_dimension_3 = Slider(2, range=0.01..2)
brick_y_dimension_3 = Slider(1, range=0.01..2)
number_of_rows_3 = Slider(13, range=1..20)
brick_z_dimension_3 = Slider(0.6, range=0.01..2)
number_of_columns_3 = Slider(14, range=1..20)

num_8 = Number(brick_x_dimension_3)
num_9 = Number(brick_y_dimension_3)
num_10 = Number(brick_z_dimension_3)
int_3 = Integer(number_of_rows_3)
int_4 = Integer(number_of_columns_3)

# ----
# Challenge 01
# Challenge 01
# Double click button
# Challenge 01: ## Challenge 01
# 
# Rotate the bricks following any logic you want, for example, according
# to their distance from a reference point (attractor point) in 3D space.
# The rotation will create a visual pattern that is very recognizable as computational design aesthetics.
# This is an essential exercise in computational design, as you will learn how to bring
# different things into a numerical relationship.
# 
# ### Details
# 
# - Starting point is your script of the main task, most things remain the same but after
#   moving the brick to its position, you will add a rotation.
# - Rotations are done using the method `.rotate()` inside the frame of an object.
#   For example, to rotate a box around the point (0, 0, 0), you can do:
#       box.frame.rotate(3.14 / 2, point=(0, 0, 0))
#   Notice that the angle of rotation is in RADIANS, not degrees.
#   You can find more details in the the API reference of COMPAS framework for the class `Frame`.
# - The amount of rotation can be determined by any logic of your choice: fixed, random, based
#   on arithmetic, based on geometry (e.g. euclidean distance), based on maths (e.g. apply
#   the math.sin function to a value), etc.
# 
# ### Bonus
# 
# - If you use an attractor point as reference, you can choose to use a referenced point
#   from Grasshopper instead of hard-coding the attractor point.
brickwall_3 = GhPythonScript(
    xsize=num_8,
    ysize=num_9,
    zsize=num_10,
    row_count=int_3,
    column_count=int_4,
    d_mortar=num_2,
    rotation_factor=num_3,
    attractor_point=attractor_point)  # -> brick_wall; inputs row_count: Int32, column_count: Int32, attractor_point: Point3d
# ---------- brickwall_3: Python ----------
"""
## Challenge 01

Rotate the bricks following any logic you want, for example, according
to their distance from a reference point (attractor point) in 3D space.
The rotation will create a visual pattern that is very recognizable as computational design aesthetics.
This is an essential exercise in computational design, as you will learn how to bring
different things into a numerical relationship.

### Details

- Starting point is your script of the main task, most things remain the same but after
  moving the brick to its position, you will add a rotation.
- Rotations are done using the method `.rotate()` inside the frame of an object.
  For example, to rotate a box around the point (0, 0, 0), you can do:
      box.frame.rotate(3.14 / 2, point=(0, 0, 0))
  Notice that the angle of rotation is in RADIANS, not degrees.
  You can find more details in the the API reference of COMPAS framework for the class `Frame`.
- The amount of rotation can be determined by any logic of your choice: fixed, random, based 
  on arithmetic, based on geometry (e.g. euclidean distance), based on maths (e.g. apply
  the math.sin function to a value), etc.

### Bonus

- If you use an attractor point as reference, you can choose to use a referenced point
  from Grasshopper instead of hard-coding the attractor point.

"""

# 0. Import everything we will need
from compas.geometry import Box, Point, Frame, Vector
from compas_rhino.conversions import point_to_compas

def build_box(x, y, z, lx, ly, lz, rangle=None, raxis=None, rpoint=None):
    """
    x, y, z are floats defining the central point of the plane that defines the box;
    lx, ly, lz are floats defining the length, width and height of the box;
    rangle is float that defines the rotation of the box in radians. 
        By default, it chooses the world XY and world origin point 
        as rotation axis and origin point.
    """
    point = Point(x, y, z)
    frame = Frame(point)
    box = Box(lx, ly, lz, frame)
    if rpoint==None:
        rpoint = point
        
    if rangle != None:
        box.rotate(angle=rangle, axis=raxis, point=rpoint)
    return box

# 1. Start with an empty list of bricks to be created
#    make sure to match the name of this list to the output of this component!
# [ADD YOUR CODE HERE...]
brick_wall = []
ref_point = point_to_compas(attractor_point)
# 2. Create two for loops, one nested inside the other,
#    to iterate over the range of row_count and column_count
for nrow in range(row_count):
    for ncol in range(column_count):

        # 3. If the row is odd, calculate an offset of half the size in X
        if nrow % 2 == 1:
            ncol = ncol+1/2

        # 4. Define the variables x, y, z based on the current column, row
        #    and the inputs for sizes, mortar gaps and offset
        px = ncol * (xsize + d_mortar)
        py = 0
        pz = nrow * zsize + (nrow-1) * d_mortar

        # 5. Create a new box
        # 6. Move brick to the correct location
        
        # 7. Rotate brick based on some logic
        #     For example, calculate the distance from the center point of the brick (x, y, z)
        #     to a reference point (either hard-coded here or referenced adding an input parameter)
        #     Hint: the formula for distance requires using square root, in python `math.sqrt`
        #           and it is as follows:
        #           math.sqrt((x2 - x1)**2 + (y2 - y1)**2 + (z2 - z1)**2)
        # the farther the ref_point is to the brick, the more it rotates;
        # if the brick is on the left hand side of the point, rotate anti-clockwise; 
        # if the brick is on the right hand side of the point, rotate clockwise.
        attracted_vector = Vector(ref_point.x-px, ref_point.y-py, 0)
        y_vector = Vector(0, 1, 0)
#        angle = attracted_vector.angle(x_vector)
        angle = y_vector.angle(attracted_vector)
        axis = y_vector.cross(attracted_vector)
        brick = build_box(px, py, pz, xsize, ysize, zsize, angle, axis)
        # 8. Append the brick to the output list
        brick_wall.append(brick)
# ---------- end brickwall_3 ----------

# ----
# Preview
draw_3 = Draw(cg=brickwall_3)  # -> rg; same code as draw
preview_3 = CustomPreview(
    Geometry=draw_3,
    Material={diffuse=RGB(197, 130, 64), emission=RGB(68, 53, 68), shine=0.5, specular=RGB(255, 254, 254), transparency=0})
