# Grasshopper definition yiqiao_wang_A-02.gh (Grasshopper 1.0.7)

# ----
# Geometry Pipeline
geometry_pipeline = GeometryPipeline(
    GroupByLayer=False,
    GroupByType=False,
    IncludeHidden=True,
    IncludeLocked=True,
    LayerFilter="Geometric_Filter",
    NameFilter="*",
    SublayerFiltering=True,
    TypeFilter=1073741848)
sunion = SolidUnion(Breps=geometry_pipeline)

is_additive = BooleanToggle(True)

# ---- group: Main task:
filter = GhPythonScript(brep=sunion, is_additive=is_additive)  # -> bfilter; inputs brep: Brep
# ---------- filter: Python ----------
"""
### Main Task

Create a new kind of filter by implementing a new class. Use the examples above
as inspiration on how to convert the filters we have seen in previous weeks to classes!

This new filter will allow intuitive control over the design by leveraging a
geometric input. Specifically, the filter should use a Brep (referenced from Rhino)
to determine whether a point should be included in the final result.


We have prepared a geometry pipeline for you on the Grasshopper canvas, that 
automatically reads all Breps on the `Geometric_Filter` Rhino layer and combines 
it to a single Brep.

Your filter class should have one method `is_included` that takes 4 parameters 
as input: point and ix, iy, iz and returns `True` or `False` as output, indicating whether the 
specific point lies inside or outside the referenced Brep.
NOTE: it's important to understand the difference between the parameters `ix`, `iy`, `iz`
which are the indices relative to the grid's start (0,0,0), and the point, which will contain x, y and z
coordinates in 3d space and will be world-relative instead.
After completion you should be able to shape or sculpt your grid to your taste.

You can configure the filter to either keep the points where True is returned,
enabling an additive sculpting workflow, or remove those points, creating a
subtractive sculpting workflow. This gives you control over whether you're
"building up" geometry by including points or "carving out" geometry by
excluding them.

#### Details

- Create a class, for example, BrepFilter.
- Add a method `is_included` to it. This method should return `True` if the 
point is inside the Brep geometry, otherwise `False. (Or you can reverse this logic to taste)
- Right below the class, create an instance of it and assign it to the output 
of this component.
- Plug the component into the Stream filter to test its functionality.


#### Bonus (Not relevant for grading)

- Add a `__str__` magic method that returns a string describing the filter in a nice way.
- Create two filters, one for an additive sculpting workflow, and one for a subtractive one.


#### Functions, classes, methods and statements that you will need

- Class definition
- A class constructor (`__init__`).
- Attributes of a class. For the Brep filter, you will need to convert the Rhino Brep to a COMPAS Brep using `Brep.from_native()`.

#### Hints
- You will use the `Brep.from_native()` method to convert the Rhino Brep to a COMPAS Brep. The `Brep`  class of COMPAS needs to be imported from `compas.geometry`.
- You need to find a method that checks whether or not a point is contained within a brep
    - https://compas.dev/compas/latest/api/index.html
    - navigate to geometry > brep and look at the provided methods.
"""

# 0. Import everything we will need
# [ADD YOUR CODE HERE...]
from compas.geometry import Brep, Point
from compas_rhino.geometry.brep import RhinoBrep

# 1. Create a new class for the new filter
class BrepFilter(object):


    # 2. Add a constructor for the new class
    # [ADD YOUR CODE HERE...]
    def __init__(self, brep, is_additive=True):
        """
        initialize a brep filter to filter.
        If additive is true, then the geometries within the 
        """
        self.brep = Brep.from_native(brep)
        self.is_additive = is_additive

    # 3. Add a method that checks for inclusion in the filter
    # [ADD YOUR CODE HERE...]
    def __str__(self):
        if self.is_additive:
            return "additive brep filter"
        else:
            return "subtractive brep filter"
            
    def ToString(self):
        return self.__str__()

    def is_included(self, point, ix, iy, iz):
        """
        check if a certain point is included within this filter (self.brep).
        ix, iy, iz is not used in this case; they are just for unifying 
        the syntax between different kinds of filters.
        
        If the point is within the brep and we need additive filtering, True is returned;
        if the point is within the brep and we need subtractive filtering, False is returned.
        ...
        
        In table form:
        
        contains(point) is_additive is_included
        True            True        True
        True            False       False
        False           True        False
        False           False       False
        
        Therefore, == is used to match this table.
        """
        return self.brep.contains(point) == self.is_additive

# 4. Create an instance of the new filter class passing the input brep
#    and assign it to the output of this component
bfilter = BrepFilter(brep, is_additive)
# ---------- end filter ----------

# ----
# Main Task: ### Main Task
# 
# Create a new kind of filter by implementing a new class. Use the examples above
# as inspiration on how to convert the filters we have seen in previous weeks to classes!
# 
# This new filter will allow intuitive control over the design by leveraging a
# geometric input. Specifically, the filter should use a Brep (referenced from Rhino)
# to determine whether a point should be included in the final result.
# 
# We have prepared a geometry pipeline for you on the Grasshopper canvas, that
# automatically reads all Breps on the `Geometric_Filter` Rhino layer and combines
# it to a single Brep.
# 
# Your filter class should have one method `is_included` that takes 4 parameters
# as input: point and ix, iy, iz and returns `True` or `False` as output, indicating whether the
# specific point lies inside or outside the referenced Brep.
# NOTE: it's important to understand the difference between the parameters `ix`, `iy`, `iz`
# which are the indices relative to the grid's start (0,0,0), and the point, which will contain x, y and z
# coordinates in 3d space and will be world-relative instead.
# After completion you should be able to shape or sculpt your grid to your taste.
# 
# You can configure the filter to either keep the points where True is returned,
# enabling an additive sculpting workflow, or remove those points, creating a
# subtractive sculpting workflow. This gives you control over whether you're
# "building up" geometry by including points or "carving out" geometry by
# excluding them.
# 
# #### Details
# 
# - Create a class, for example, BrepFilter.
# - Add a method `is_included` to it. This method should return `True` if the
# point is inside the Brep geometry, otherwise `False. (Or you can reverse this logic to taste)
# - Right below the class, create an instance of it and assign it to the output
# of this component.
# - Plug the component into the Stream filter to test its functionality.
# 
# 
# #### Bonus (Not relevant for grading)
# 
# - Add a `__str__` magic method that returns a string describing the filter in a nice way.
# - Create two filters, one for an additive sculpting workflow, and one for a subtractive one.
# 
# 
# #### Functions, classes, methods and statements that you will need
# 
# - Class definition
# - A class constructor (`__init__`).
# - Attributes of a class. For the Brep filter, you will need to convert the Rhino Brep to a COMPAS Brep using `Brep.from_native()`.
# 
# #### Hints
# - You will use the `Brep.from_native()` method to convert the Rhino Brep to a COMPAS Brep. The `Brep`  class of COMPAS needs to be imported from `compas.geometry`.
# - You need to find a method that checks whether or not a point is contained within a brep
#     - https://compas.dev/compas/latest/api/index.html
#     - navigate to geometry > brep and look at the provided methods.
# Main Task
# Main Task
# Double click button
# Filtering grids with object-oriented programming
# Examples of filters
modulo_filter = GhPythonScript()  # -> mfilter
# ---------- modulo_filter: Python ----------
# Sample filter
class ModuleBasedFilter(object):
    def is_included(self, point, ix, iy, iz):
        if (ix + iy) % 2 == 0:
            return True

        return False

mfilter = ModuleBasedFilter()
# ---------- end modulo_filter ----------
random_filter = GhPythonScript()  # -> rfilter
# ---------- random_filter: Python ----------
# Sample filter
from random import choice

class RandomFilter(object):
    def is_included(self, point, ix, iy, iz):
        return choice([True, False])

rfilter = RandomFilter()
# ---------- end random_filter ----------
linear_filter = GhPythonScript()  # -> lfilter
# ---------- linear_filter: Python ----------
# Sample filter
class LinearFilter(object):
    def __init__(self, coefficient=1, vertical_shift_x=0, vertical_shift_y=0, horizontal_shift_x=0, horizontal_shift_y=0):
        super(LinearFilter, self).__init__()
        self.coefficient = coefficient
        self.vertical_shift_x = vertical_shift_x
        self.vertical_shift_y = vertical_shift_y
        self.horizontal_shift_x = horizontal_shift_x
        self.horizontal_shift_y = horizontal_shift_y

    def is_included(self, point, ix, iy, iz):
        z_range_x = (self.coefficient * ix + self.vertical_shift_x) + self.horizontal_shift_x
        z_range_y = (self.coefficient * iy + self.vertical_shift_y) + self.horizontal_shift_y
        return not z_range_x < iz > z_range_y

lfilter = LinearFilter(coefficient= 1.7, vertical_shift_x= -3, vertical_shift_y=-3, horizontal_shift_x=0, horizontal_shift_y=0)
# ---------- end linear_filter ----------
parab_filter = GhPythonScript()  # -> pfilter
# ---------- parab_filter: Python ----------
# Sample filter
class ParaboloidFilter(object):
    def __init__(self, coefficient, horizontal_shift_x, horizontal_shift_y, vertical_shift_x, vertical_shift_y):
        super(ParaboloidFilter, self).__init__()
        self.coefficient = coefficient
        self.vertical_shift_x = vertical_shift_x
        self.vertical_shift_y = vertical_shift_y
        self.horizontal_shift_x = horizontal_shift_x
        self.horizontal_shift_y = horizontal_shift_y


    # Paraboloid filter function
    def is_included(self, point, ix, iy, iz):
        z_paraboloid_x = (self.coefficient * ((ix + self.vertical_shift_x) ** 2 + (iy + self.vertical_shift_y) ** 2)) + self.horizontal_shift_x
        z_paraboloid_y = (self.coefficient * ((iy + self.vertical_shift_x) ** 2 + (ix + self.vertical_shift_x) ** 2)) + self.horizontal_shift_y
    
        # Check if the z value of the point is less than or equal to the z value of the paraboloid
        return z_paraboloid_x > iz < z_paraboloid_y

pfilter = ParaboloidFilter(coefficient=0.2, vertical_shift_x= -4, vertical_shift_y=4, horizontal_shift_x=0, horizontal_shift_y=1)
# ---------- end parab_filter ----------

# ----
# Main Task
panel = Panel(filter)

# ----
# Challenge 02
list = ValueList({"Union": 1, "Intersection": 2}, selected="Intersection")

# ----
# Challenge 01
# Challenge 01
# Double click button
# Challenge 01: ## Challenge 01
# 
# In this challenge, you will extend the current box visualization setup by introducing an additional data value for each point in the grid based on its Z-coordinate. This value will be remapped to a range from 0 to 255, and output along with the boxes. Then this data will be connected to a color component to control the material color based on the height of each point.
# 
# Your goal is to calculate this additional data value for every box included in the final grid, then output it alongside the existing boxes.
# 
# 
# #### Details
# 
# - For each filtered point in the grid, calculate a value based on its Z-coordinate.
# - Remap the Z-coordinate of each point to a value between 0 and 255.
# - Create a new output variable (in the Grasshopper component) to store these remapped values.
# - Ensure both the boxes and the corresponding Z-values are outputted for further use (i.e., for coloring the boxes in Grasshopper).
# 
# 
# 
# #### Functions, methods and statements that you will need
# 
# - A remapping function to transform Z-coordinates into the range [0, 255].
# - `.append` to store the remapped Z-values.
# - The min() and max() functions to help with remapping.
value_list = ValueList({"Modulo filter": 0, "Random filter": 1, "Linear filter": 2, "Paraboloid filter": 3, "Main task filter": 4, "Challenge 02 filter": 5}, selected="Challenge 02 filter")

# ---- group: Challenge 02
filter_2 = GhPythonScript(filter1=linear_filter, filter2=filter, mode=list)  # -> mfilter
# ---------- filter_2: Python ----------
"""
## Challenge 02

In this challenge, you will create a filter that combines two existing filters and allows you to control 
how they are combined using either Union (OR) or Intersection (AND) logic. The `is_included` method should 
return `True` based on the logic chosen:

- Union: This logic returns True if either of the filters returns True. It works like "Include the point if 
it satisfies either filter."
- Intersection: This logic returns True only if both filters return True. It works like "Include the point 
only if it satisfies both filters."

#### Details

- Create a new class `MergeFilter` that combines two filters using either of the two proposed logics.
- The constructor (`__init__`) should take two filters as parameters (`f1` and `f2`).
- Implement an `is_included` method that checks the points based on either the Union (OR) or 
Intersection (AND) logic.

#### Bonus Tasks (Not relevant for Grading)

- Allow for a Switch between the two methods, by introducing a Boolean Toggle
- Change the initial Geometric-Filter from the Main Task to work for multiple input geometries. Rather 
than using the Solid Union Grasshopper component, implement functionality, such that the filter class 
handles multiple geometries by itself.

#### Functions, methods, and statements that you will need

- Class definition.
- `if` statement.
- Logical operators (`and`, `or`).
- Use an attribute of the class to inform which mode should be chosen.
"""

# 0. Import everything we will need
# [ADD YOUR CODE HERE...]

# 1. Create a new class for the merge filter
class MergeFilter(object):
    def __init__(self, f1, f2, mode):
        self.f1 = f1
        self.f2 = f2
        self.mode = mode
        
    def is_included(self, point, ix, iy, iz):
        is_in1 = self.f1.is_included(point, ix, iy, iz)
        is_in2 = self.f2.is_included(point, ix, iy, iz)
        if mode == 1:
            return is_in1 or is_in2
        elif mode == 2:
            return is_in1 and is_in2
        else:
            error("mode must be either 1 (Union) or 2 (intersection)!")
        
    def __str__(self):
        return "merged filter between '{0}' and '{1}' using logic {2}".format(self.f1, self.f2, self.mode)
            
    def ToString(self):
        return self.__str__()

    # 2. Add a constructor for the new class accepting the input sub-filters
    # [ADD YOUR CODE HERE...]

    # 3. Add a method that checks for inclusion in sub-filters
    # [ADD YOUR CODE HERE...]



# 4. Create an instance of the new filter class passing the two other filters
#    that need to be combined/merged and assign it to the output of this component
# [ADD YOUR CODE HERE...]
mfilter = MergeFilter(filter1, filter2, mode)
# ---------- end filter_2 ----------

# ----
stream_filter = StreamFilter(
    Gate=value_list,
    Stream0=modulo_filter,
    Stream1=random_filter,
    Stream2=linear_filter,
    Stream3=parab_filter,
    Stream4=filter,
    Stream5=filter_2)

# ---- group: Cell sizes
number_slider = Slider(4, range=0..20)
number_slider_2 = Slider(4, range=0..20)
number_slider_3 = Slider(4.5, range=0..20)

# ---- group: Grid size
number_slider_4 = Slider(14, range=0..20)
number_slider_5 = Slider(14, range=0..20)
number_slider_6 = Slider(15, range=0..20)

# ----
s_2 = Data(stream_filter)
list_2 = ValueList({"red": "r", "green": "g", "blue": "b"}, selected="red")
panel_2 = Panel(list_2)
# Challenge 01
grid = GhPythonScript(
    nx=number_slider_4,
    ny=number_slider_5,
    nz=number_slider_6,
    selected_filter=s_2,
    xsize=number_slider,
    ysize=number_slider_2,
    zsize=number_slider_3)  # -> points, boxes, z_values, colors, colored_boxes; inputs nx: Int32, ny: Int32, nz: Int32
# ---------- grid: Python ----------
"""
## Challenge 01

In this challenge, you will extend the current box visualization setup by
introducing an additional data value for each point in the grid based on its 
Z-coordinate. This value will be remapped to a range from 0 to 255, and output 
along with the boxes. Then this data will be connected to a color component to 
control the material color based on the height of each point.

Your goal is to calculate this additional data value for every box included in 
the final grid, then output it alongside the existing boxes.


#### Details

- For each filtered point in the grid, calculate a value based on its Z-coordinate.
- Remap the Z-coordinate of each point to a value between 0 and 255.
- Create a new output variable (in the Grasshopper component) to store these remapped values.
- Ensure both the boxes and the corresponding Z-values are outputted for further 
  use (i.e., for coloring the boxes in Grasshopper).



#### Functions, methods and statements that you will need

- A remapping function to transform Z-coordinates into the range [0, 255].
- `.append` to store the remapped Z-values.
- The min() and max() functions to help with remapping.

"""

from compas.geometry import Box
from compas.geometry import Point
#from compas.scene import SceneObject
#from compas.scene import Scene
#from compas.colors import Color

#class MyBox(Box):
#    def __init__(self, *args, **kwargs):
#        super(MyBox, self).__init__(*args, **kwargs)
#    
#    def colored_box(self, color_tuple):
#        """
#        here, the color argument should be a tuple of three integers, 
#        ranging from 0 to 255.
#        """
#        color_normalized = tuple(c / 256 for c in color_tuple)
#        color_compas = Color(*color_normalized)
#        return SceneObject(item=self, color=color_compas)

# Initialize lists for points, boxes, and color values
points = []
boxes = []

# 1. Add a variable to output the color values
#    and add a matching output to this component
z_coordinates = [] # record z coordinates in advance to prevent an extra iteration of searching

# Ensure a filter is selected, otherwise display a message
if not selected_filter:
    ghenv.Component.Message = "Select a filter!"
else:
    ghenv.Component.Message = ""

    # Iterate through the grid to create points
    for x in range(nx):
        for y in range(ny):
            for z in range(nz):
                corner_1 = Point(x * xsize, y * ysize, z * zsize)
                corner_2 = Point(corner_1.x + xsize, corner_1.y + ysize, corner_1.z)

                if selected_filter.is_included(corner_1, x, y, z):
                    points.append(corner_1)
                    z_coordinates.append(corner_1.z)
                    # box = MyBox.from_corner_corner_height(corner_1, corner_2, zsize)
                    box =Box.from_corner_corner_height(corner_1, corner_2, zsize)
                    boxes.append(box)

                    # 2. Remap the values of the Z-coordinate (or any other of your liking)
                    #    to the 0-255 range and output it as color value
                    #    you will need to use a Color component of Grasshopper and
                    #    a custom preview component as well to use those values to
                    #    recolor the boxes that the "Draw" component is creating
                    # [ADD YOUR CODE HERE...]

zmax = max(z_coordinates)
zmin = min(z_coordinates)

z_values = [(lambda z: round((z-zmin)/(zmax-zmin)*256))(z) for z in z_coordinates]

#colors = [(int(r), int(g), int(b)) for r in z_values]
#
#colored_boxes = [box.colored_box(colors[i]) for i, box in enumerate(boxes)]
#
#scene = Scene()
#for i, box in enumerate(boxes):
##    box.colored_box(colors[i]).draw()
#    scene.add(box, color=(1, 2, 3))
#    
#scene.draw()
# ---------- end grid ----------

# ---- group: Cell sizes
number_slider_7 = Slider(122, range=0..255)
number_slider_8 = Slider(112, range=0..255)

# ----
draw = Draw(cg=grid.points)  # -> rg
#   port cg: The COMPAS geometry or datastructure to be drawn.
# ---------- draw: Python ----------
from compas.geometry import Point, Box
from compas_rhino.conversions import point_to_rhino, box_to_rhino

rg = None
if cg:
    if isinstance(cg, Point):
        rg = point_to_rhino(cg)
    elif isinstance(cg, Box):
        rg = box_to_rhino(cg)
# ---------- end draw ----------
panel_3 = Panel(grid.z_values)
python = GhPythonScript(boxes=grid.boxes)  # -> out, boxes_rhino; inputs boxes: list
# ---------- python: Python ----------
from compas_rhino.conversions import box_to_rhino

boxes_rhino = []
for box in boxes:
    box_rhino = box_to_rhino(box)
    boxes_rhino.append(box_rhino)
# ---------- end python ----------
draw_2 = Draw(cg=grid.boxes)  # -> flatten(rg); same code as draw

# ---- group: 1. Select target directory
# Challenge 02
# Generate a .png image of your current Rhino viewport
# Challenge 02
# Double click button
# Challenge 02: ## Challenge 02
# 
# In this challenge, you will create a filter that combines two existing filters and allows you to control how they are combined using either Union (OR) or Intersection (AND) logic. The `is_included` method should return `True` based on the logic chosen:
# 
# - Union: This logic returns True if either of the filters returns True. It works like "Include the point if it satisfies either filter."
# - Intersection: This logic returns True only if both filters return True. It works like "Include the point only if it satisfies both filters."
# 
# #### Details
# 
# - Create a new class `MergeFilter` that combines two filters using either of the two proposed logics.
# - The constructor (`__init__`) should take two filters as parameters (`f1` and `f2`).
# - Implement an `is_included` method that checks the points based on either the Union (OR) or  Intersection (AND) logic.
# 
# #### Bonus Tasks (Not relevant for Grading)
# 
# - Allow for a Switch between the two methods, by introducing a Boolean Toggle
# - Change the initial Geometric-Filter from the Main Task to work for multiple input geometries. Rather than using the Solid Union Grasshopper component, implement functionality, such that the filter class handles multiple geometries by itself.
# 
# #### Functions, methods, and statements that you will need
# 
# - Class definition.
# - `if` statement.
# - Logical operators (`and`, `or`).
# - Use an attribute of the class to inform which mode should be chosen.
path = FilePath("C:\Users\wangy\Documents\GitHub\coding_architecture_hs24\assignments\A02-filtered-point-grid\")

# ---- group: 2. Set file name
mustermann_max = Panel("yiqiao_wang")
assignment_nr = Panel("A02_")

# ---- group: 4. Set display options
toggle = BooleanToggle(False)
toggle_2 = BooleanToggle(False)

# ---- group: 5. Click button to save image
button = Button()

# ---- group: 3. Set image dimensions
width = Panel("3200")
height = Panel("2400")

# ----
rgb = ColourRGB(Alpha=255, Red=grid.z_values, Green=number_slider_8, Blue=number_slider_7)
preview = CustomPreview(Geometry=python.boxes_rhino, Material=rgb)
python_2 = GhPythonScript(
    path=path,
    name=mustermann_max,
    assignment_nr=assignment_nr,
    width=width,
    height=height,
    display_grid=toggle,
    display_grid_axes=toggle_2,
    save=button)  # -> out; inputs width: Int32, height: Int32
# ---------- python_2: Python ----------
import Rhino.Display as rd
import scriptcontext as sc
import System
import os

file_name = name + "_" + assignment_nr

def get_next_index(path):
    index = 1
    while os.path.exists(path + file_name + str(index) + ".png"):
        index += 1
    return index

def ViewCaptureToFile(path):
    view = sc.doc.Views.ActiveView
    if view:
        view_capture = rd.ViewCapture()
        view_capture.TransparentBackground = False
        view_capture.Width = view.ActiveViewport.Size.Width
        view_capture.Height = view.ActiveViewport.Size.Width
        view_capture.ScaleScreenItems = False
        view_capture.DrawAxes = True
        view_capture.DrawGrid = display_grid
        view_capture.DrawGridAxes = display_grid_axes
        size = System.Drawing.Size(view_capture.Width, view_capture.Height)
        size = System.Drawing.Size(width, height)
        
        settings = rd.ViewCaptureSettings(view, size, 72) # view, size, dpi
        settings.RasterMode = True
        settings.DrawGrid = display_grid
        settings.DrawAxis = display_grid_axes
        settings.DrawWallpaper = False
        index = get_next_index(path)
            
        filename = file_name + str(index)
        filename_with_extension = filename + ".png"
        bitmap = rd.ViewCapture.CaptureToBitmap(settings)
        fullpath = path + filename_with_extension
        bitmap.Save(fullpath)
        
        return filename_with_extension
        
        
if path is None:
    ghenv.Component.Message = "Please select a target directory first"
else:
    if save:
        path = ViewCaptureToFile(path)
        ghenv.Component.Message = "Saved image to " + path
# ---------- end python_2 ----------
