# Grasshopper definition yiqiao_wang_A-03.gh (Grasshopper 1.0.7)

# ----
# Geometry Pipeline
geometry_pipeline = GeometryPipeline(
    GroupByLayer=False,
    GroupByType=False,
    IncludeHidden=True,
    IncludeLocked=True,
    LayerFilter="Geometric_Filter",
    NameFilter="*",
    SublayerFiltering=True,
    TypeFilter=1073741848)
sunion = SolidUnion(Breps=geometry_pipeline)

is_additive = BooleanToggle(True)

# ----
# Applying classes to create buildings
# Main Task
mainbeam_class = GhPythonScript()  # -> MainBeam
# ---------- mainbeam_class: Python ----------
class MainBeam(object):
    def __init__(self, geometry, edge):
        self.geometry = geometry
        self.edge = edge
# ---------- end mainbeam_class ----------
slab_class = GhPythonScript()  # -> Slab
# ---------- slab_class: Python ----------
# Create the Slab class here
class Slab(object):
    def __init__(self, geometry, halfface, category=None):
        self.geometry = geometry
        self.halfface = halfface
        self.category = category
# ---------- end slab_class ----------
column_class = GhPythonScript()  # -> Column
# ---------- column_class: Python ----------
class Column(object):
    def __init__(self, geometry, edge):
        self.geometry = geometry
        self.edge = edge
# ---------- end column_class ----------
buildinggrid_class = GhPythonScript(MainBeam=mainbeam_class, Column=column_class, Slab=slab_class)  # -> BuildingGrid
# ---------- buildinggrid_class: Python ----------
"""
## Main task

Goal: Create slabs for our building grid.

A slab is represented visually as a box (using compas.geometry.Box).
The basic idea is to rely on volmesh to know where to add each slab.
We will create one slab per each face of our grid's volmesh if the face is 
aligned to the XY plane (ie. flat).

We will create a Slab class that will contain the attributes and methods of each slab.
The Slab class needs 3 attributes: `geometry` (a box), `category` (a string), and
the `halfface` id (an integer) from which we created the slab.
The attribute `category` will only be used if you tackle challenge 01.
Otherwise you can ignore it.

#### Details

The algorithm that we need to implement, as well as hints to functions you might need,
is in code comments, as a step-by-step guide.

"""

from compas.geometry import Box
from compas.geometry import Frame
from compas.geometry import Line
from compas.geometry import Point
from compas.geometry import Vector
from compas.datastructures import VolMesh


# The building grid class contains both data (attributes)
# of our grid and also its behavior (methods)
class BuildingGrid(object):
    def __init__(self, xsize, ysize, zsize, nx, ny, nz, selected_filter):
        self.volmesh = self.create_volmesh(selected_filter, xsize, ysize, zsize, nx, ny, nz)
        self.columns = []
        self.main_beams = []
        self.slabs = []

    # START OF MAIN TASK
    # Create a generate_slabs method that takes a slab_height as parameter
    # and appends slabs to the self.slabs attribute of the grid instance
    # Unlike in previous exercises, the slabs will not just be boxes, but we
    # will create instances of a class Slab that we define in the component
    # before this one. Creating the definition of the Slab class is also part
    # of the main task. You have as examples the main beam and column
    # components that are doing the same 
    def generate_slabs(self, slab_height):
        # 1. Reset slabs list to an empty list
        self.slabs = []
        # ... your code here ...

        # 2. Iterate: for each face in the volmesh (hint: faces() of volmesh)
        for face in self.volmesh.faces():
        # ... your code here ...
        
            # 3. Get the normal of the half-face (hint: face_normal() of volmesh)
            # ... your code here ...
            normal = self.volmesh.face_normal(face)

            # 4. Calculate dot product of the face normal to the Z axis vector
            #    if it's parallel to the unit Z axis, we will add a slab
            # ... your code here ...

            dot_product = normal.dot(Vector.Zaxis())
            if dot_product in (1, -1):
                # face is facing upwards or downwards, create a slab

                # 5. To add a slab, first find the centroid of the half-face (hint: halfface_centroid() of volmesh)
                # ... your code here ...
                centroid = self.volmesh.halfface_centroid(face)
                
                # 6. Find the points of the face (hint: face_points() of volmesh)
                # ... your code here ...
                points = self.volmesh.face_points(face)

                # 7. Create a box using two corner points + the slab_height parameter 
                #    (hint: use Box.from_corner_corner_height)
                # ... your code here ...
                box = Box.from_corner_corner_height(points[0], points[2], slab_height)

                # 8. Create an instance of the slab class you created above
                # ... your code here ...
                slab = Slab(box, face)

                # 9. Append it to the grid.slabs attribute list
                # ... your code here ...
                self.slabs.append(slab)
                
    # END OF MAIN TASK
                

    # Generate columns and append them to the self.columns attribute
    def generate_columns(self, column_width_x, column_depth_y):
        self.column_width_x = column_width_x
        self.column_depth_y = column_depth_y
        
        # First reset the list of columns
        self.columns = []

        # Now generate columns
        for uv in self.volmesh.edges():
            # If the edge vector is parallel to unit vector Z...
            edge_vector = self.volmesh.edge_direction(uv)

            if edge_vector.dot(Vector.Zaxis()) in (1, -1):
                # ...we add a column
                edge_midpoint = self.volmesh.edge_point(uv)
                edge_length = self.volmesh.edge_length(uv)

                box = Box(column_width_x, column_depth_y, edge_length)
                box.frame.point = edge_midpoint
                
                column = Column(box, uv)
                self.columns.append(column)
                
     

    # This method is provided as is
    # It shows how to create main beams
    # Main beams are a nbit more complicated than columns
    # because they need to be adjusted in length to match the column
    def generate_main_beams(self, main_beam_width, main_beam_height):
        # First reset the list of main beams
        self.main_beams = []

        for uv in self.volmesh.edges():
            edge_vector = self.volmesh.edge_direction(uv)

            if edge_vector.dot(Vector.Zaxis()) == 0:

                start, end = self.volmesh.edge_coordinates(uv)
                line = Line(start, end)
                
                # Shorten the beam to fit the columns
                if edge_vector.dot(Vector.Xaxis()) in (1, -1):
                    shift_value = self.column_width_x
                else:
                    shift_value = self.column_depth_y
 
                # Create the box in the origin of world XY frame
                box = Box.from_width_height_depth(main_beam_width, main_beam_height, line.length - shift_value)
                frame = Frame(line.midpoint, edge_vector.cross(Vector.Zaxis()), edge_vector)
                frame.point.z -= main_beam_height / 2
        
                # Move box to correct frame
                box.frame = frame
                
                mainbeam = MainBeam(box, uv)
                self.main_beams.append(mainbeam)

    def create_volmesh(self, selected_filter, xsize, ysize, zsize, nx, ny, nz):
        volmesh = VolMesh()
        vertex_keys = dict()

        for ix in range(nx):
            for iy in range(ny):
                for iz in range(nz):
                    corner_1 = Point(ix * xsize, iy * ysize, iz * zsize)
                    corner_2 = Point(corner_1.x + xsize, corner_1.y + ysize, corner_1.z)
                    
                    # Only add cell if within filter
                    if selected_filter.is_included(corner_1, ix, iy, iz):
                        box = Box.from_corner_corner_height(corner_1, corner_2, zsize)
                        corner_points = box.compute_vertices()
                        vertices = []

                        for v in corner_points:
                            gkey = str(v)
                            if gkey not in vertex_keys:
                                vertex_keys[gkey] = volmesh.add_vertex(x=v[0], y=v[1], z=v[2])

                            vertex = vertex_keys[gkey]
                            vertices.append(vertex)

                        a, b, c, d, e, f, g, h = vertices
                        faces = [
                            [a,d,c,b],  # bottom face
                            [a,e,f,d],  # front face
                            [a,b,h,e],  # left face
                            [b,c,g,h],  # back face
                            [d,f,g,c],  # right face
                            [e,h,g,f],  # top face
                        ]

                        # Add the cell with the defined faces
                        volmesh.add_cell(faces, attr_dict=dict(ix=ix, iy=iy, iz=iz))
        
        return volmesh

    def number_of_columns(self):
        return len(self.columns)
    
    def number_of_main_beams(self):
        return len(self.main_beams)

    def calculate_volume(self):
        pass
        
if __name__ == "__main__":
    pass
# ---------- end buildinggrid_class ----------

list = ValueList({"Union": 1, "Intersection": 2}, selected="Union")

# ---- group: Options
main_beam_width = Slider(0.35, range=0.1..0.9)
main_beam_height = Slider(0.4, range=0.1..0.9)
column_width_x = Slider(0.35, range=0.1..0.9)
column_depth_y = Slider(0.45, range=0.1..0.9)
slab_height = Slider(0.55, range=0.1..0.9)

# ---- group: Grid size
# Challenge 01: ## Challenge 01
# 
# Goal: Assign the category of each slab
# 
# Each slab can be assigned one of three different categories: "roof", "floor_slab" or "bottom_slab".
# 
# Depending on each category we want to visualize the slabs with a different color.
# 
# #### Details
# 
# The algorithm that we need to implement, as well as hints to functions you might need,
# is in code comments, as a step-by-step guide.
number_slider = Slider(9, range=0..20)
number_slider_2 = Slider(9, range=0..20)
number_slider_3 = Slider(20, range=0..20)

# ---- group: Cell sizes
number_slider_4 = Slider(7, range=0..20)
number_slider_5 = Slider(4.5, range=0..20)
number_slider_6 = Slider(3.5, range=0..20)

# ---- group: 2. Set file name
# Challenge 02: ## Challenge 02
# 
# Goal: Visualize all the slabs in our building grid in a stacked or "palletized" version.
# 
# The idea is to take all the slabs that are created in the building, and
# make a copy of and visualize them in stacks of slabs, as if they were in
# pallets for transportation.
# 
# #### Details
# 
# The algorithm that we need to implement, as well as hints to functions
# you might need, is in code comments, as a step-by-step guide.
mustermann_max = Panel("yiqiao_wang")
assignment_nr = Panel("A03_2")

# ---- group: 4. Set display options
toggle = BooleanToggle(False)
toggle_2 = BooleanToggle(True)

# ---- group: 5. Click button to save image
button = Button()

# ---- group: 3. Set image dimensions
height = Panel("2400")
width = Panel("3200")

# ---- group: 1. Select target directory
path = FilePath("C:\Users\wangy\Documents\GitHub\coding_architecture_hs24\assignments\A03-building-grid\A03_Yiqiao_Wang\")

# ----
python = GhPythonScript(
    path=path,
    name=mustermann_max,
    assignment_nr=assignment_nr,
    width=width,
    height=height,
    display_grid=toggle,
    display_grid_axes=toggle_2,
    save=button)  # -> out; inputs width: Int32, height: Int32
# ---------- python: Python ----------
import Rhino.Display as rd
import scriptcontext as sc
import System
import os

file_name = name + "_" + assignment_nr

def get_next_index(path):
    index = 1
    while os.path.exists(path + file_name + str(index) + ".png"):
        index += 1
    return index

def ViewCaptureToFile(path):
    view = sc.doc.Views.ActiveView
    if view:
        view_capture = rd.ViewCapture()
        view_capture.TransparentBackground = False
        view_capture.Width = view.ActiveViewport.Size.Width
        view_capture.Height = view.ActiveViewport.Size.Width
        view_capture.ScaleScreenItems = False
        view_capture.DrawAxes = True
        view_capture.DrawGrid = display_grid
        view_capture.DrawGridAxes = display_grid_axes
        size = System.Drawing.Size(view_capture.Width, view_capture.Height)
        size = System.Drawing.Size(width, height)
        
        settings = rd.ViewCaptureSettings(view, size, 72) # view, size, dpi
        settings.RasterMode = True
        settings.DrawGrid = display_grid
        settings.DrawAxis = display_grid_axes
        settings.DrawWallpaper = False
        index = get_next_index(path)
            
        filename = file_name + str(index)
        filename_with_extension = filename + ".png"
        bitmap = rd.ViewCapture.CaptureToBitmap(settings)
        fullpath = path + filename_with_extension
        bitmap.Save(fullpath)
        
        return filename_with_extension
        
        
if path is None:
    ghenv.Component.Message = "Please select a target directory first"
else:
    if save:
        path = ViewCaptureToFile(path)
        ghenv.Component.Message = "Saved image to " + path
# ---------- end python ----------

# ----
# Filter Classes
# Filter Selection
# Brep Filter: Use your Brep filter from A02 here!
# Brep Filter: Use your merge filter from A02 here!
bfilter = GhPythonScript(brep=sunion, is_additive=is_additive)  # -> bfilter; inputs brep: Brep
# ---------- bfilter: Python ----------
"""
### Main Task

Create a new kind of filter by implementing a new class. Use the examples above
as inspiration on how to convert the filters we have seen in previous weeks to classes!

This new filter will allow intuitive control over the design by leveraging a
geometric input. Specifically, the filter should use a Brep (referenced from Rhino)
to determine whether a point should be included in the final result.


We have prepared a geometry pipeline for you on the Grasshopper canvas, that 
automatically reads all Breps on the `Geometric_Filter` Rhino layer and combines 
it to a single Brep.

Your filter class should have one method `is_included` that takes 4 parameters 
as input: point and ix, iy, iz and returns `True` or `False` as output, indicating whether the 
specific point lies inside or outside the referenced Brep.
NOTE: it's important to understand the difference between the parameters `ix`, `iy`, `iz`
which are the indices relative to the grid's start (0,0,0), and the point, which will contain x, y and z
coordinates in 3d space and will be world-relative instead.
After completion you should be able to shape or sculpt your grid to your taste.

You can configure the filter to either keep the points where True is returned,
enabling an additive sculpting workflow, or remove those points, creating a
subtractive sculpting workflow. This gives you control over whether you're
"building up" geometry by including points or "carving out" geometry by
excluding them.

#### Details

- Create a class, for example, BrepFilter.
- Add a method `is_included` to it. This method should return `True` if the 
point is inside the Brep geometry, otherwise `False. (Or you can reverse this logic to taste)
- Right below the class, create an instance of it and assign it to the output 
of this component.
- Plug the component into the Stream filter to test its functionality.


#### Bonus (Not relevant for grading)

- Add a `__str__` magic method that returns a string describing the filter in a nice way.
- Create two filters, one for an additive sculpting workflow, and one for a subtractive one.


#### Functions, classes, methods and statements that you will need

- Class definition
- A class constructor (`__init__`).
- Attributes of a class. For the Brep filter, you will need to convert the Rhino Brep to a COMPAS Brep using `Brep.from_native()`.

#### Hints
- You will use the `Brep.from_native()` method to convert the Rhino Brep to a COMPAS Brep. The `Brep`  class of COMPAS needs to be imported from `compas.geometry`.
- You need to find a method that checks whether or not a point is contained within a brep
    - https://compas.dev/compas/latest/api/index.html
    - navigate to geometry > brep and look at the provided methods.
"""

# 0. Import everything we will need
# [ADD YOUR CODE HERE...]
from compas.geometry import Brep, Point
from compas_rhino.geometry.brep import RhinoBrep

# 1. Create a new class for the new filter
class BrepFilter(object):


    # 2. Add a constructor for the new class
    # [ADD YOUR CODE HERE...]
    def __init__(self, brep, is_additive=True):
        """
        initialize a brep filter to filter.
        If additive is true, then the geometries within the 
        """
        self.brep = Brep.from_native(brep)
        self.is_additive = is_additive

    # 3. Add a method that checks for inclusion in the filter
    # [ADD YOUR CODE HERE...]
    def __str__(self):
        if self.is_additive:
            return "additive brep filter"
        else:
            return "subtractive brep filter"
            
    def ToString(self):
        return self.__str__()

    def is_included(self, point, ix, iy, iz):
        """
        check if a certain point is included within this filter (self.brep).
        ix, iy, iz is not used in this case; they are just for unifying 
        the syntax between different kinds of filters.
        
        If the point is within the brep and we need additive filtering, True is returned;
        if the point is within the brep and we need subtractive filtering, False is returned.
        ...
        
        In table form:
        
        contains(point) is_additive is_included
        True            True        True
        True            False       False
        False           True        False
        False           False       False
        
        Therefore, == is used to match this table.
        """
        return self.brep.contains(point) == self.is_additive

# 4. Create an instance of the new filter class passing the input brep
#    and assign it to the output of this component
bfilter = BrepFilter(brep, is_additive)
# ---------- end bfilter ----------
# Main Task: ## Main task
# 
# Goal: Create slabs for our building grid.
# 
# A slab is represented visually as a box (using compas.geometry.Box).
# The basic idea is to rely on volmesh to know where to add each slab.
# We will create one slab per each face of our grid's volmesh if the face is
# aligned to the XY plane (ie. flat).
# 
# We will create a Slab class that will contain the attributes and methods of each slab.
# The Slab class needs 3 attributes: `geometry` (a box), `category` (a string), and
# the `halfface` id (an integer) from which we created the slab.
# The attribute `category` will only be used if you tackle challenge 01.
# Otherwise you can ignore it.
# 
# #### Details
# 
# The algorithm that we need to implement, as well as hints to functions you might need,
# is in code comments, as a step-by-step guide.
modulo_filter = GhPythonScript()  # -> mfilter
# ---------- modulo_filter: Python ----------
# Sample filter
class ModuleBasedFilter(object):
    def is_included(self, point, ix, iy, iz):
        if (ix + iy) % 2 == 0:
            return True

        return False

mfilter = ModuleBasedFilter()
# ---------- end modulo_filter ----------
random_filter = GhPythonScript()  # -> rfilter
# ---------- random_filter: Python ----------
# Sample filter
from random import choice

class RandomFilter(object):
    def is_included(self, point, ix, iy, iz):
        return choice([True, False])

rfilter = RandomFilter()
# ---------- end random_filter ----------
linear_filter = GhPythonScript()  # -> lfilter
# ---------- linear_filter: Python ----------
# Sample filter
class LinearFilter(object):
    def __init__(self, coefficient=1, vertical_shift_x=0, vertical_shift_y=0, horizontal_shift_x=0, horizontal_shift_y=0):
        super(LinearFilter, self).__init__()
        self.coefficient = coefficient
        self.vertical_shift_x = vertical_shift_x
        self.vertical_shift_y = vertical_shift_y
        self.horizontal_shift_x = horizontal_shift_x
        self.horizontal_shift_y = horizontal_shift_y

    def is_included(self, point, ix, iy, iz):
        z_range_x = (self.coefficient * ix + self.vertical_shift_x) + self.horizontal_shift_x
        z_range_y = (self.coefficient * iy + self.vertical_shift_y) + self.horizontal_shift_y
        return not z_range_x < iz > z_range_y

lfilter = LinearFilter(coefficient= 1.7, vertical_shift_x= -3, vertical_shift_y=-3, horizontal_shift_x=0, horizontal_shift_y=0)
# ---------- end linear_filter ----------
parab_filter = GhPythonScript()  # -> pfilter
# ---------- parab_filter: Python ----------
# Sample filter
class ParaboloidFilter(object):
    def __init__(self, coefficient, horizontal_shift_x, horizontal_shift_y, vertical_shift_x, vertical_shift_y):
        super(ParaboloidFilter, self).__init__()
        self.coefficient = coefficient
        self.vertical_shift_x = vertical_shift_x
        self.vertical_shift_y = vertical_shift_y
        self.horizontal_shift_x = horizontal_shift_x
        self.horizontal_shift_y = horizontal_shift_y


    # Paraboloid filter function
    def is_included(self, point, ix, iy, iz):
        z_paraboloid_x = (self.coefficient * ((ix + self.vertical_shift_x) ** 2 + (iy + self.vertical_shift_y) ** 2)) + self.horizontal_shift_x
        z_paraboloid_y = (self.coefficient * ((iy + self.vertical_shift_x) ** 2 + (ix + self.vertical_shift_x) ** 2)) + self.horizontal_shift_y
    
        # Check if the z value of the point is less than or equal to the z value of the paraboloid
        return z_paraboloid_x > iz < z_paraboloid_y

pfilter = ParaboloidFilter(coefficient=0.2, vertical_shift_x= -4, vertical_shift_y=4, horizontal_shift_x=0, horizontal_shift_y=1)
# ---------- end parab_filter ----------
value_list = ValueList({"Modulo filter": 0, "Random filter": 1, "Linear filter": 2, "Paraboloid filter": 3, "Brep filter": 4, "Merge filter": 5}, selected="Brep filter")

# ---- group: Challenge 02
mfilter = GhPythonScript(filter1=linear_filter, filter2=bfilter, mode=list)  # -> mfilter
# ---------- mfilter: Python ----------
"""
Use your implementation of the Merge Filter from A02 here!
"""

# Copy and Paste your solution from A02 here
# [ADD YOUR CODE HERE...]
# ---------- end mfilter ----------

# ----
stream_filter = StreamFilter(
    Gate=value_list,
    Stream0=modulo_filter,
    Stream1=random_filter,
    Stream2=linear_filter,
    Stream3=parab_filter,
    Stream4=bfilter,
    Stream5=mfilter)

# ----
# Create instance of building grid
filter = Data(stream_filter)
buildinggrid = Data(buildinggrid_class)
create_building = GhPythonScript(
    nx=number_slider,
    ny=number_slider_2,
    nz=number_slider_3,
    xsize=number_slider_4,
    ysize=number_slider_5,
    zsize=number_slider_6,
    selected_filter=filter,
    main_beam_width=main_beam_width,
    main_beam_height=main_beam_height,
    column_width_x=column_width_x,
    column_depth_y=column_depth_y,
    slab_height=slab_height,
    BuildingGrid=buildinggrid)  # -> grid; inputs nx: Int32, ny: Int32, nz: Int32
# ---------- create_building: Python ----------
# Create an instance of our building grid
grid = BuildingGrid(xsize, ysize, zsize, nx, ny, nz, selected_filter)

grid.generate_columns(column_width_x, column_depth_y)
grid.generate_main_beams(main_beam_width, main_beam_height)

# TODO
grid.generate_slabs(slab_height)
# ---------- end create_building ----------

# ----
# Challenge 01
python_2 = GhPythonScript(grid=create_building)  # -> grid
# ---------- python_2: Python ----------
"""
## Challenge 01

Goal: Assign the category of each slab

Each slab can be assigned one of three different categories: 
"roof", "floor_slab" or "bottom_slab". 

Depending on each category we want to visualize the slabs with a different color.

#### Details

The algorithm that we need to implement, as well as hints to functions you might need,
is in code comments, as a step-by-step guide.
"""
from compas.geometry import Vector

# 1. Iterate over the existing slabs in the grid.slabs list
# ... your code here ...
for slab in grid.slabs:
    # 2. Find out which half face corresponds to the slab
    halfface = slab.halfface
#    print(grid.volmesh.halfface_opposite_cell(halfface))

    # 3. Detect if there's a cell opposite to the half-face we're in (hint: halfface_opposite_cell() of volmesh)
    # if no opposite cell, then cell_id_opposite == None
    cell_id_opposite = grid.volmesh.halfface_opposite_cell(halfface)

    # 4. Get the normal of the half-face (hint: face_normal() of volmesh)
    v_normal = grid.volmesh.face_normal(halfface, unitized=True)

    # 5. Calculate dot product of the face normal to the Z axis vector
    dot_product = v_normal.dot(Vector.Zaxis())
    
    # 6. Assign the slab category attribute based on the following logic:
    # If there's an opposite cell, it's a "floor_slab" category
    # if not, and the dot_product_z_axis is positive, it's a "bottom_slab"
    # if not, and the dot_product_z_axis is negative, it's a "roof"
    if cell_id_opposite == None:
        if dot_product == 1:
            slab.category = "bottom_slab"
        elif dot_product == -1:
            slab.category = "roof"
        else:
            raise NotImplementedError("tilted slab not yet supported!")
    elif type(cell_id_opposite) == int:
        slab.category = "floor_slab"
    else:
        raise ValueError("id of cell opposite to the slab must be an integer!")
# ---------- end python_2 ----------

# ---- group: Columns
columns = GhPythonScript(grid=python_2)  # -> columns
# ---------- columns: Python ----------
# We use this direct conversion instead of the component
# because we want the Box BREP instead of the meshes
from compas_rhino.conversions import box_to_rhino

columns = []

for column in grid.columns:
    column = box_to_rhino(column.geometry)
    columns.append(column)
# ---------- end columns ----------
custom_preview = CustomPreview(Geometry=columns, Material=ColourSwatch(SwatchColor=RGBA(115, 41, 41, 124)))

# ---- group: Main beams
main_beams = GhPythonScript(grid=python_2)  # -> mainbeams
# ---------- main_beams: Python ----------
# We use this direct conversion instead of the component
# because we want the Box BREP instead of the meshes
from compas_rhino.conversions import box_to_rhino

mainbeams = []

for mainbeam in grid.main_beams:
    b = box_to_rhino(mainbeam.geometry)
    mainbeams.append(b)
# ---------- end main_beams ----------
custom_preview_2 = CustomPreview(Geometry=main_beams, Material=ColourSwatch(SwatchColor=RGBA(252, 129, 35, 156)))

# ---- group: Cells
# Visualization
number_slider_7 = Slider(30, range=0..1161)
grid = Data(python_2)
cells = GhPythonScript(i=number_slider_7, grid=grid)  # -> cells
# ---------- cells: Python ----------
from compas_rhino.conversions import mesh_to_rhino

cells = []
for x in grid.volmesh.cells():
    if x < i:
        cells.append(mesh_to_rhino(grid.volmesh.cell_to_mesh(x)))
# ---------- end cells ----------
custom_preview_3 = CustomPreview(Geometry=cells, Material=ColourSwatch(SwatchColor=RGBA(41, 115, 111, 124)))

# ----
merge = Merge(
    Data1=ColourSwatch(SwatchColor=RGBA(178, 145, 255, 135)),
    Data2=ColourSwatch(SwatchColor=RGBA(235, 208, 188, 173)),
    Data3=ColourSwatch(SwatchColor=RGBA(92, 167, 247, 131)))
slabs = GhPythonScript(grid=python_2, available_colors=merge)  # -> slabs, colors; inputs available_colors: list
# ---------- slabs: Python ----------
# We use this direct conversion instead of the component
# because we want the Box BREP instead of the meshes
from compas_rhino.conversions import box_to_rhino

slabs = []
colors = []

for slab in grid.slabs:
    box = box_to_rhino(slab.geometry)
    
    if slab.category == "roof":
        colors.append(available_colors[0])
    elif slab.category == "bottom_slab":
        colors.append(available_colors[1])
    else:
        colors.append(available_colors[2])
        
    slabs.append(box)
# ---------- end slabs ----------
custom_preview_4 = CustomPreview(Geometry=slabs.slabs, Material=slabs.colors)

# ----
# Challenge 02
pt = Point(Point(83.81634951, 0, 0))
slabs_2 = GhPythonScript(
    grid=python_2,
    stack_point=pt,
    max_height=Slider(10, range=1..75),
    row_limit=Slider(10, range=1..75),
    x_offset=Slider(8.895, range=0..10),
    y_offset=Slider(9.09, range=0..10),
    z_offset=Slider(0.7, range=0..10))  # -> stacked_slabs, stacked_slabs_original; inputs stack_point: Point3d, max_height: Int32
# ---------- slabs_2: Python ----------
"""
## Challenge 02

Goal: Visualize all the slabs in our building grid in a stacked or "palletized" version.

The idea is to take all the slabs that are created in the building, and 
make a copy of and visualize them in stacks of slabs, as if they were in
pallets for transportation.

#### Details

The algorithm that we need to implement, as well as hints to functions
you might need, is in code comments, as a step-by-step guide.

"""
from compas_rhino.conversions import box_to_rhino
from compas.geometry import Point
import copy


# 1. Create an empty list to store the stacked slabs
stacked_slabs = []
slabs_roof = []
slabs_bottom = []
slabs_floor = []
slabs_sorted = []
stacked_slabs_original = []

for slab in grid.slabs:
    if slab.category == "roof":
        slabs_roof.append(slab)
    elif slab.category == "bottom_slab":
        slabs_bottom.append(slab)
    else:
        slabs_floor.append(slab)

slabs_sorted = slabs_roof + slabs_bottom + slabs_floor
# 2. Iterate over all slabs
#    Hint: since you will need both the slab instance and the index of
#          it to calculate position, use the enumerate() method of python
#          if you don't want to keep a separate counter variable
for idx, slab in enumerate(slabs_sorted):

    # 3. For each slab, we need to find out in which row and column
    #    of pallets to place it. 
    """
    Since we only have row limit and max height, the column can be expanded infinitely.
    The slabs will be piled up (z) in the first row (x), first column (y) until max height.
    Then it fills the second row, first column until max height.
    """
    
    # n_fullpiles accounts for how many full piles of slabs have already been stacked.
    # the remainder iz is the height (z-position) of the current slab
    n_fullpiles, iz = divmod(idx, max_height)
    
    """
    full pile of slabs fill up all the rows (along the column) before moving to the next column
    so the number of columns iy is the result of devision, while number of rows ix is the remainder.
    take the following example:
    * * *
    * * *
    * * *
    * * o
    * *
    The point o is on the third column (because there are already two filled up columns)
    and on the fourth row (the remainder is 4)
    """
    iy, ix = divmod(n_fullpiles, row_limit)
    
    # 4. Calculate x, y, z coordinates based on the starting stack_point 
    #    and the results calculated above
    x = ix * x_offset
    y = iy * y_offset
    z = iz * z_offset

    # 5. Copy the slab's geometry! We don't want to modify the one in the building
    slab_copy = copy.deepcopy(slab)
    
    # 6. Assign x, y, z to the copied geometry
    # ... your code here ...
    slab_copy.geometry.frame.point = Point(stack_point.X+x, stack_point.Y+y, stack_point.Z+z)

    
    # 7. Convert to a rhino box and append to list
    # ... your code here ...
    box_rhino = box_to_rhino(slab_copy.geometry)
    stacked_slabs.append(box_rhino)
    stacked_slabs_original.append(slab_copy)
# ---------- end slabs_2 ----------
custom_preview_5 = CustomPreview(Geometry=slabs_2.stacked_slabs, Material=ColourSwatch(SwatchColor=RGBA(145, 134, 15, 135)))

merge_2 = Merge(
    Data1=ColourSwatch(SwatchColor=RGBA(178, 145, 255, 135)),
    Data2=ColourSwatch(SwatchColor=RGBA(235, 208, 188, 173)),
    Data3=ColourSwatch(SwatchColor=RGBA(92, 167, 247, 131)))
slabs_3 = GhPythonScript(slabs=slabs_2.stacked_slabs_original, available_colors=merge_2)  # -> slabs_rhino, colors; inputs slabs: list, available_colors: list
# ---------- slabs_3: Python ----------
# We use this direct conversion instead of the component
# because we want the Box BREP instead of the meshes
from compas_rhino.conversions import box_to_rhino

slabs_rhino = []
colors = []

for slab in slabs:
    print(slab.category)
    box = box_to_rhino(slab.geometry)
    
    if slab.category == "roof":
        colors.append(available_colors[0])
    elif slab.category == "bottom_slab":
        colors.append(available_colors[1])
    else:
        colors.append(available_colors[2])
        
    slabs_rhino.append(box)
# ---------- end slabs_3 ----------
custom_preview_6 = CustomPreview(Geometry=slabs_3.slabs_rhino, Material=slabs_3.colors)
