# Grasshopper definition random_cubes.gh (Grasshopper 1.0.7)

dist = Slider(7, range=0..10)
python = GhPythonScript(nx=Slider(7, range=0..10), ny=Slider(8, range=0..10), nz=dist)  # -> out, points
# ---------- python: Python ----------
from compas.geometry import Point
from compas_rhino.conversions import point_to_rhino
from itertools import product
from random import choice

nx = int(nx)
ny = int(ny)
nz = int(nz)
points = []
#for x in range(nx):
#    for y in range(ny):
#        for z in range(nz):
#            pt = Point(x, y, z)
#            point = point_to_rhino(pt)
#            points.append(point)


grid = product(range(nx), range(ny), range(nz))
for x, y, z in grid:
    if choice([True, False]):
        pt = Point(x, y, z)
        point = point_to_rhino(pt)
        points.append(point)
# ---------- end python ----------
