# Grasshopper definition 02-building-grid-tutorial-01_hs24.gh (Grasshopper 1.0.7)

# ----
# Applying classes to create buildings
# Create building grid class
define_buildinggrid_class = GhPythonScript()  # -> BuildingGrid
# ---------- define_buildinggrid_class: Python ----------
from compas.geometry import Box
from compas.geometry import Frame
from compas.geometry import Line
from compas.geometry import Point
from compas.geometry import Vector
from compas.datastructures import VolMesh


# Create a new class called BuildingGrid 
# [TODO: Add your code here]
class BuildingGrid(object):
    # Add a constructor for the grid, accepting sizes, amounts and filter instance
    # Remember to initialize the columns and main_beams lists as attributes of this instance 
    # [TODO: Add your code here]
    def __init__(self, selected_filter, xsize, ysize, zsize, nx, ny, nz):
        self.volmesh = self.create_volmesh(selected_filter, xsize, ysize, zsize, nx, ny, nz)
        
        # Add a generate_columns(self, column_width_x, column_depth_y) method that creates boxes
        # for each column and appends to the self.columns list
        # [TODO: Add your code here]
    def generate_columns(self, column_width_x, column_depth_y):
        self.column_width_x = column_width_x
        self.column_depth_y = column_depth_y
        self.columns = []
        for edge in self.volmesh.edges():
            edge_vector = self.volmesh.edge_direction(edge)
            # print(edge_vector)
            if edge_vector.dot(Vector.Zaxis()) in (1, -1):
                # a vertical edge, can be used to build column
                edge_midpoint = self.volmesh.edge_point(edge)
                edge_length = self.volmesh.edge_length(edge)
                column = Box(self.column_width_x, self.column_depth_y, edge_length)
                column.frame.point = edge_midpoint
                self.columns.append(column)

    def generate_main_beams(self, main_beam_width, main_beam_height):
        self.main_beams = []
        for uv in self.volmesh.edges():
            edge_vector = self.volmesh.edge_direction(uv)

            if edge_vector.dot(Vector.Zaxis()) == 0:

                start, end = self.volmesh.edge_coordinates(uv)
                line = Line(start, end)
                shift_value = 0
                # Shorten the beam to fit the columns
                if hasattr(self, "column_width_x") and hasattr(self, "column_depth_y"):
                    if edge_vector.dot(Vector.Xaxis()) in (1, -1):
                        shift_value = self.column_width_x
                    else:
                        shift_value = self.column_depth_y
                
                # Create the box in the origin of world XY frame
                mainbeam = Box.from_width_height_depth(main_beam_width, main_beam_height, line.length - shift_value)
                frame = Frame(line.midpoint, edge_vector.cross(Vector.Zaxis()), edge_vector)
                frame.point.z -= main_beam_height / 2
        
                # Move box to correct frame
                mainbeam.frame = frame

                self.main_beams.append(mainbeam)


        # This method is provided as well
        # It is basically the same we did before with box grids
        # but now we add the boxes as cells of the VolMesh data structure
        
    def create_volmesh(self, selected_filter, xsize, ysize, zsize, nx, ny, nz):
        volmesh = VolMesh()
        
        for ix in range(nx):
            for iy in range(ny):
                for iz in range(nz):
                    corner_1 = Point(ix*xsize, iy*ysize, iz*zsize)
                    corner_2 = Point(corner_1.x + xsize, 
                                     corner_1.y + ysize,
                                     corner_1.z,
                                     )
                    
                    if selected_filter.is_included(corner_1, ix, iy, iz):
                        box = Box.from_corner_corner_height(corner_1, corner_2, zsize)
                        corner_points = box.compute_vertices()
                        vertex_keys = []
                        for point in corner_points:
                            vertex_key = volmesh.add_vertex(x=point.x, y=point.y, z=point.z)
                            vertex_keys.append(vertex_key)
                        
                        a, b, c, d, e, f, g, h = vertex_keys
                        faces = [
                                    [a, b, c, d],  # bottom face
                                    [e, h, g, f],  # top face
                                    [a, d, f, e],  # front face
                                    [b, h, g, c],  # back face
                                    [a, b, h, e],  # left face
                                    [d, c, g, f],  # right face
                                 ]
                        volmesh.add_cell(faces, attr_dict=dict(ix=ix, iy=iy, iz=iz))
                
        return volmesh
# ---------- end define_buildinggrid_class ----------
buildinggrid = Data(define_buildinggrid_class)

# ----
# Filters selection
modulo_filter = GhPythonScript()  # -> mfilter
# ---------- modulo_filter: Python ----------
# Sample filter
class ModuleBasedFilter(object):
    def is_included(self, point, ix, iy, iz):
        if (ix + iy) % 2 == 0:
            return True

        return False

mfilter = ModuleBasedFilter()
# ---------- end modulo_filter ----------
random_filter = GhPythonScript()  # -> rfilter
# ---------- random_filter: Python ----------
# Sample filter
from random import choice

class RandomFilter(object):
    def is_included(self, point, ix, iy, iz):
        return choice([True, False])

rfilter = RandomFilter()
# ---------- end random_filter ----------
linear_filter = GhPythonScript()  # -> lfilter
# ---------- linear_filter: Python ----------
# Sample filter
class LinearFilter(object):
    def __init__(self, coefficient=1, vertical_shift_x=0, vertical_shift_y=0, horizontal_shift_x=0, horizontal_shift_y=0):
        super(LinearFilter, self).__init__()
        self.coefficient = coefficient
        self.vertical_shift_x = vertical_shift_x
        self.vertical_shift_y = vertical_shift_y
        self.horizontal_shift_x = horizontal_shift_x
        self.horizontal_shift_y = horizontal_shift_y

    def is_included(self, point, ix, iy, iz):
        z_range_x = (self.coefficient * ix + self.vertical_shift_x) + self.horizontal_shift_x
        z_range_y = (self.coefficient * iy + self.vertical_shift_y) + self.horizontal_shift_y
        return not z_range_x < iz > z_range_y

lfilter = LinearFilter(coefficient= 1.7, vertical_shift_x= -3, vertical_shift_y=-3, horizontal_shift_x=0, horizontal_shift_y=0)
# ---------- end linear_filter ----------
parab_filter = GhPythonScript()  # -> pfilter
# ---------- parab_filter: Python ----------
# Sample filter
class ParaboloidFilter(object):
    def __init__(self, coefficient, horizontal_shift_x, horizontal_shift_y, vertical_shift_x, vertical_shift_y):
        super(ParaboloidFilter, self).__init__()
        self.coefficient = coefficient
        self.vertical_shift_x = vertical_shift_x
        self.vertical_shift_y = vertical_shift_y
        self.horizontal_shift_x = horizontal_shift_x
        self.horizontal_shift_y = horizontal_shift_y


    # Paraboloid filter function
    def is_included(self, point, ix, iy, iz):
        z_paraboloid_x = (self.coefficient * ((ix + self.vertical_shift_x) ** 2 + (iy + self.vertical_shift_y) ** 2)) + self.horizontal_shift_x
        z_paraboloid_y = (self.coefficient * ((iy + self.vertical_shift_x) ** 2 + (ix + self.vertical_shift_x) ** 2)) + self.horizontal_shift_y
    
        # Check if the z value of the point is less than or equal to the z value of the paraboloid
        return z_paraboloid_x > iz < z_paraboloid_y

pfilter = ParaboloidFilter(coefficient=0.2, vertical_shift_x= -4, vertical_shift_y=4, horizontal_shift_x=0, horizontal_shift_y=1)
# ---------- end parab_filter ----------
value_list = ValueList({"Modulo filter": 0, "Random filter": 1, "Linear filter": 2, "Paraboloid filter": 3}, selected="Linear filter")
stream_filter = StreamFilter(Gate=value_list, Stream0=modulo_filter, Stream1=random_filter, Stream2=linear_filter, Stream3=parab_filter)

# ---- group: Grid size
number_slider = Slider(9, range=0..20)
number_slider_2 = Slider(9, range=0..20)
number_slider_3 = Slider(9, range=0..20)

# ---- group: Cell sizes
number_slider_4 = Slider(5, range=0..20)
number_slider_5 = Slider(3.5, range=0..20)
number_slider_6 = Slider(4.5, range=0..20)

# ---- group: Options
main_beam_height = Slider(0.4, range=0.1..0.9)
column_width_x = Slider(0.35, range=0.1..0.9)
column_depth_y = Slider(0.45, range=0.1..0.9)
main_beam_width = Slider(0.35, range=0.1..0.9)

# ----
# Create instance of building grid
buildinggrid_2 = Data(buildinggrid)
filter = Data(stream_filter)
grid = GhPythonScript(
    BuildingGrid=buildinggrid_2,
    selected_filter=filter,
    nx=number_slider,
    ny=number_slider_2,
    nz=number_slider_3,
    xsize=number_slider_4,
    ysize=number_slider_6,
    zsize=number_slider_5,
    main_beam_width=main_beam_width,
    main_beam_height=main_beam_height,
    column_width_x=column_width_x,
    column_depth_y=column_depth_y)  # -> grid; inputs nx: Int32, ny: Int32, nz: Int32
# ---------- grid: Python ----------
# Create an instance of our building grid
grid = BuildingGrid(selected_filter, xsize, ysize, zsize, nx, ny, nz)
grid.generate_columns(column_width_x, column_depth_y)
grid.generate_main_beams(main_beam_width, main_beam_height)
# ---------- end grid ----------

# ---- group: Cells
# Visualization
number_slider_7 = Slider(1161, range=0..1161)
cells = GhPythonScript(i=number_slider_7, grid=grid)  # -> cells
# ---------- cells: Python ----------
from compas_rhino.conversions import mesh_to_rhino

cells = []
for x in grid.volmesh.cells():
    if x < i:
        cells.append(mesh_to_rhino(grid.volmesh.cell_to_mesh(x)))
# ---------- end cells ----------
custom_preview = CustomPreview(Geometry=cells, Material=ColourSwatch(SwatchColor=RGBA(41, 115, 111, 124)))

# ---- group: Columns
columns = GhPythonScript(grid=grid)  # -> columns
# ---------- columns: Python ----------
# We use this direct conversion instead of the component
# because we want the Box BREP instead of the meshes
from compas_rhino.conversions import box_to_rhino

columns = []

for column in grid.columns:
    column = box_to_rhino(column)
    columns.append(column)
# ---------- end columns ----------
custom_preview_2 = CustomPreview(Geometry=columns, Material=ColourSwatch(SwatchColor=RGBA(115, 41, 41, 124)))

# ---- group: Main beams
main_beams = GhPythonScript(grid=grid)  # -> mainbeams
# ---------- main_beams: Python ----------
# We use this direct conversion instead of the component
# because we want the Box BREP instead of the meshes
from compas_rhino.conversions import box_to_rhino

mainbeams = []

for mainbeam in grid.main_beams:
    b = box_to_rhino(mainbeam)
    mainbeams.append(b)
# ---------- end main_beams ----------
custom_preview_3 = CustomPreview(Geometry=main_beams, Material=ColourSwatch(SwatchColor=RGBA(252, 129, 35, 156)))
